% Simulink data dictionary SSC.sldd

MeasurementsBus = Simulink.Bus()
  Vgrid: double, Unit="V"
  Uc: double, Unit="V"
  I_ph1: double, Unit="A"
  I_ph2: double, Unit="A"

simSwitchingFrequency = Simulink.Parameter(500, Unit="Hz")  % Switching frequency for simulation part.